# Grasshopper definition AC_Week5_KARAMBA-2_00.gh (Grasshopper 1.0.7)
# plug-ins: LunchBox, Karamba3D, Kangaroo2 Components, Weaverbird

geo = Geometry([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])

# ----
# SubD Surface
subd = SubD(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)

preview = CustomPreview(Geometry=geo, Material=ColourSwatch(SwatchColor=RGB(0, 0, 0)))
qrsettings = QuadRemeshSettings(
    TargetCount=Slider(500, range=0..10000),
    AdaptiveSize=0,
    AdaptiveCount=False,
    HardEdges=False,
    SeamEdges=0,
    Symmetry=0,
    GuideCurves=0)
meshsubd = MeshFromSubD(SubD=subd, Density=2)
debrep = DeconstructBrep(Brep=subd)  # -> Faces, Edges, Vertices

# ----
# Structure depth
number_slider = Slider(1.5, range=0..10)

qrmesh = QuadRemesh(Mesh=meshsubd, Settings=qrsettings)

# ----
# Nurbs Surface
brep = Brep(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)

mesh = Mesh(qrmesh)
# LunchBox
number_slider_2 = Slider(6, range=2..50)

# ----
# SPACE FRAME FOR SUBD SURFACES
faceb = FaceBoundaries(Mesh=mesh)
m_conface = ConnectedFaces(M=mesh)  # -> out, G, A, T, P
# ---------- m_conface: VB ----------
    Component.Params.Input(0).Name = "Mesh"
    Component.Params.Input(0).Description = "Open or closed mesh"
    Component.Params.Input(1).Name = "Connected Domain"
    Component.Params.Input(1).Description = "The domain that describes the range of connected faces to be tested against"

    Component.Params.Output(1).Name = "Preview Mesh"
    Component.Params.Output(1).Description = "A greyscale preview mesh reflecting the range of values"
    Component.Params.Output(2).Name = "Connections"
    Component.Params.Output(2).Description = "The number of faces connected to each face of the mesh"
    Component.Params.Output(3).Name = "Topology"
    Component.Params.Output(3).Description = "The list of index values connected to the sample point"
    Component.Params.Output(4).Name = "Pattern"
    Component.Params.Output(4).Description = "If the R input is used, the status of each sample point relative to the provided range (0 = Below, 1 = Within, 2 = Above)"

    If M IsNot Nothing Then
      Dim i,j,k,s As Integer

      Dim iP As Grasshopper.Kernel.IGH_Param = Component.Params.Input(0)
      Dim cP As Grasshopper.Kernel.Data.IGH_Structure = iP.VolatileData

      Dim mf As Rhino.Geometry.Collections.MeshFaceList = Nothing
      Dim mfn As Rhino.Geometry.Collections.MeshFaceNormalList = Nothing
      Dim mv As Rhino.Geometry.Collections.MeshVertexList = Nothing
      Dim mtv As Rhino.Geometry.Collections.MeshTopologyVertexList = Nothing
      Dim mte As Rhino.Geometry.Collections.MeshTopologyEdgeList = Nothing
      Dim mn As Rhino.Geometry.Collections.MeshVertexNormalList = Nothing
      Dim mc As Rhino.Geometry.Collections.MeshVertexColorList = Nothing

      mf = m.Faces
      mfn = m.FaceNormals
      mv = m.Vertices
      mtv = m.TopologyVertices
      mte = m.TopologyEdges
      mn = m.Normals
      mc = m.VertexColors

      Dim arrK As New list(Of Integer)
      Dim treeK As New datatree(Of Integer)
      Dim oc As New list(Of color)
      Dim tv,tmin,tmax As Integer
      Dim arrPat As New list(Of Integer)

      Dim mfo As New list(Of MeshFace)
      Dim mvo As New list(Of point3d)

      For i = 0 To mf.count() - 1 Step 1
        Dim tcv() As Integer

        tcv = mf.AdjacentFaces(i)
        s = mvo.count()

        k = (ubound(tcv) + 1)

        If mf.item(i).isquad() Then
          mvo.add(mv.item(mf.item(i).A))
          mvo.add(mv.item(mf.item(i).B))
          mvo.add(mv.item(mf.item(i).C))
          mvo.add(mv.item(mf.item(i).D))
          mfo.add(New meshface(s, s + 1, s + 2, s + 3))
        Else
          mvo.add(mv.item(mf.item(i).A))
          mvo.add(mv.item(mf.item(i).B))
          mvo.add(mv.item(mf.item(i).C))
          mfo.add(New meshface(s, s + 1, s + 2))
        End If

        Dim tang,ang, aMin, aMax As New Double
        For j = 0 To ubound(tcv) Step 1
          treeK.add(tcv(j), cp.Path(Component.RunCount - 1).AppendElement(i))
        Next

        If k < Tmin Then Tmin = k
        If i = 0 Then Tmax = k Else If k > Tmax Then Tmax = k
        arrK.add(k)
      Next

      If R = Nothing Then
        R.t0 = Tmin
        R.t1 = Tmax
      End If

      For i = 0 To mf.count() - 1 Step 1
        If mf.item(i).isquad() Then k = 3 Else k = 2
        If arrK.item(i) < R.T0 Then
          For j = 0 To k Step 1
            oc.add(color.FromArgb(0, 0, 255))
          Next
          arrPat.add(0)
        ElseIf ((arrK.item(i) > R.T1) Or ((R.t0 = 0) And (R.t1 = 0))) Then
          For j = 0 To k Step 1
            oc.add(color.FromArgb(255, 0, 0))
          Next
          arrPat.add(2)
        Else
          For j = 0 To k Step 1
            tv = math.Floor((arrK.item(i) - R.T0) / (R.t1 - R.t0) * 255)
            oc.add(color.FromArgb(tv, tv, tv))
          Next
          arrPat.add(1)
        End If
      Next
      Dim mo As New mesh
      mo.vertices.AddVertices(mvo.toarray())
      mo.Faces.AddFaces(mfo.toarray())
      mo.VertexColors.AppendColors(oc.toarray())

      G = mo
      A = arrK
      P = arrPat
      T = treeK
    End If
# ---------- end m_conface ----------
facen = FaceNormals(Mesh=mesh)  # -> Centers, Normals
amp = Amplitude(Vector=facen.Normals, Amplitude=number_slider)
panel = Panel(m_conface.T)
move = Move(Geometry=facen.Centers, Motion=amp)  # -> Geometry, Transform
disc = Discontinuity(Curve=faceb, Level=1)  # -> Points, Parameters
item = ListItem(List=move.Geometry, Index=panel, Wrap=True)
explode = Explode(Curve=faceb, Recursive=True)  # -> Segments, Vertices
ln = Line(StartPoint=disc.Points, EndPoint=graft(move.Geometry))
ln_2 = Line(StartPoint=graft(move.Geometry), EndPoint=item)
crv = Curve(explode.Segments)

gridbraced1d = BracedGrid1DStructure(Surface=debrep.Faces, UDivisions=number_slider_2, VDivisions=Slider(6, range=2..50))  # -> PrimaryLines, BraceLines, StructureNodes
pt = Point(flatten(gridbraced1d.StructureNodes))
pt_2 = Point([Point(-151.4729776, -123.9559935, 0), Point(-147.9569204, -123.0660918, 0), Point(-146.2400585, -120.6467195, 0), Point(-145.3927106, -119.1317326, 0), Point(-145.0078531, -116.9721484, 0), Point(-145.088143, -113.824788, 0)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])
spacetruss_1 = SpaceTrussStructure1(Surface=brep, UDivisions=Slider(20, range=5..30), VDivisions=Slider(10, range=5..30), TrussDepth=Slider(2, range=0..10))  # -> LinesA, LinesB, Web, Nodes
merge = Merge(Data1=gridbraced1d.PrimaryLines, Data2=gridbraced1d.BraceLines)  # -> flatten(Result)
len = Length(Curve=merge)
cps = ClosestPoints(Point=pt_2, Cloud=pt, Count=Slider(2, range=0..10))  # -> ClosestPoint, CPIndex, Distance
crv_2 = Curve([spacetruss_1.LinesA, spacetruss_1.LinesB, spacetruss_1.Web])
panel_2 = Panel(len)

brep_2 = Brep(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)
brep_3 = Brep(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)
debrep_2 = DeconstructBrep(Brep=brep_3)  # -> Faces, Edges, Vertices
debrep_3 = DeconstructBrep(Brep=brep_2)  # -> Faces, Edges, Vertices
panel_3 = Panel("""1
3""")
panel_4 = Panel("""4
5""")
panel_5 = Panel("""1
3""")
panel_6 = Panel("""0
2""")
item_2 = ListItem(List=debrep_2.Faces, Index=panel_5, Wrap=True)  # -> simplify(graft(Item))
item_3 = ListItem(List=debrep_2.Faces, Index=panel_4, Wrap=True)  # -> simplify(graft(Item))
item_4 = ListItem(List=debrep_3.Faces, Index=panel_3, Wrap=True)  # -> simplify(graft(Item))
item_5 = ListItem(List=debrep_3.Faces, Index=panel_6, Wrap=True)  # -> simplify(graft(Item))
number_slider_3 = Slider(1, range=0..1)
number_slider_4 = Slider(5, range=0..10)
number_slider_5 = Slider(1, range=0..10)
gridbraced2d = BracedGrid2DStructure(Surface=item_4, UDivisions=Slider(1, range=0..10), VDivisions=Slider(3, range=0..10))  # -> PrimaryLines, BraceLines, StructureNodes
gridbraced2d_2 = BracedGrid2DStructure(Surface=item_2, UDivisions=number_slider_4, VDivisions=number_slider_5)  # -> PrimaryLines, BraceLines, StructureNodes
gridbraced1d_2 = BracedGrid1DStructure(Surface=item_3, UDivisions=number_slider_5, VDivisions=number_slider_4)  # -> PrimaryLines, BraceLines, StructureNodes
gridbraced2d_3 = BracedGrid2DStructure(Surface=item_5, UDivisions=Slider(2, range=0..10), VDivisions=Slider(3, range=0..10))  # -> PrimaryLines, BraceLines, StructureNodes
merge_2 = Merge(
    Data1=gridbraced2d_2.PrimaryLines,
    Data2=gridbraced2d_2.BraceLines,
    Data3=gridbraced1d_2.PrimaryLines,
    Data4=gridbraced1d_2.BraceLines,
    Data5=gridbraced2d_3.PrimaryLines,
    Data6=gridbraced2d_3.BraceLines,
    Data7=gridbraced2d.PrimaryLines,
    Data8=gridbraced2d.BraceLines)

flatten = FlattenTree(Tree=ln_2, Path="{0}")
len_2 = Length(Curve=crv)
dupln = RemoveDuplicateLines(Lines=flatten, Tolerance=0.01)
panel_7 = Panel(len_2)

# ----
# Envelope
wbweave = WeaverbirdsMeshFromLinesWeaveBack(Lines=flatten(dupln), MaximumValence=Slider(5, range=0..10))

# ----
# Space Frame
# Structure
merge_3 = Merge(Data1=ln, Data2=ln_2, Data3=crv)  # -> flatten(Result)

# ----
# 1. Or the SubD
# here
number_slider_6 = Slider(1, range=1..3)
meshsubd_2 = MeshFromSubD(SubD=subd, Density=number_slider_6)
triremesh = TriRemesh(Geometry=meshsubd_2, Length=Slider(0.5, range=0..1), Iterations=25)  # -> Triangulation, Dual, Creases

pdecon = Deconstruct(Point=flatten(gridbraced2d.StructureNodes))  # -> XComponent, YComponent, ZComponent

# ----
# 3. Select the
# corresponding
# number
number_slider_7 = Slider(73, range=0..88)

# ----
# 3. Select the
# corresponding
# number
number_slider_8 = Slider(27, range=0..72)

smaller = SmallerThan(FirstNumber=pdecon.ZComponent, SecondNumber=Slider(0.5, range=0..1))  # -> SmallerThan, OrEqualTo

# ----
# 1. Connect the
# structure lines
# here
dupln_2 = RemoveDuplicateLines(Lines=flatten(merge), Tolerance=0.01)

# ----
# 2. Connect the
# supporting points
# here
rdpoints = RemoveDuplicatePointsKaramba3D(Point=flatten(cps.ClosestPoint), LimitDistance=0.005)  # -> OutPoint, Info, Indexes

# ----
# 3. Shell
# Thickness
number_slider_9 = Slider(15, range=0..100)

item_6 = ListItem(List=debrep_2.Faces, Index="4", Wrap=True)
cull = CullPattern(List=flatten(gridbraced2d.StructureNodes), CullPattern=smaller.SmallerThan)

# ----
# 1. Connect the
# structure lines
# here
dupln_3 = RemoveDuplicateLines(Lines=flatten(merge_3), Tolerance=0.01)

pt_3 = Point(flatten(cull))

# ----
# CANTILEVER
# D = L/180
# Beam View
# Model View
# Analyse
# Assemble the Model
# Create Beams
# Create Columns
# Create Supports
# Cross-Sections
# Gravity Load
# Extra Load
readcstable = ReadCrossSectionTableFromFileKaramba3D()  # -> CrossSection, Info
tmatch = MatchText(Text=readcstable.CrossSection, RegEx="Australia", Case=True)
cull_2 = CullPattern(List=readcstable.CrossSection, CullPattern=tmatch)
panel_8 = Panel("WC")
panel_9 = Panel("SHS")
panel_10 = Panel("CHS")
panel_11 = Panel("RHS")
tmatch_2 = MatchText(Text=cull_2, RegEx="WB", Case=True)
cull_3 = CullPattern(List=cull_2, CullPattern=tmatch_2)
panel_12 = Panel(cull_3)
slab = Surface(item_6)
beams = Curve(merge_2)
rdlines = RemoveDuplicateLinesKaramba3D(Line=flatten(beams), LimitDistance=0.005)  # -> OutLine, Info, Indexes
mesh_breps = MeshBrepsKaramba3D(
    Brep=slab,
    MeshResolution=Slider(0.5, range=0..1),
    EdgeRefinementFactor=0.67,
    PointReduction=False,
    SmoothingStepSize=0,
    SmoothingIterations=5)  # -> Mesh, Info
rdpoints_2 = RemoveDuplicatePointsKaramba3D(Point=pt_3, LimitDistance=0.005)  # -> OutPoint, Info, Indexes
item_7 = ListItem(List=cull_3, Index=Slider(22, range=0..22), Wrap=True)
Z = UnitZ(Factor="-1.8")
supp = SupportKaramba3D(PosInd=rdpoints_2.OutPoint, menu=[buttons(on, on, on, on, on, on)])
loads = LoadsKaramba3D(Vector=Vector(0, 0, -1), mode="Gravity")
loads_2 = LoadsKaramba3D(Vectors=Z, Mesh=mesh_breps.Mesh, mode="MeshLoad -Variable", menu=[buttons(off, on, off), buttons(on, on)])
linetobeam = LineToBeamKaramba3D(Line=rdlines.OutLine, CrossSection=item_7, New=True, Remove=True, LimitDistance_m=0.005)  # -> Element, Points, Info
assemble = AssembleModelKaramba3D(Elem=flatten(linetobeam.Element), Support=flatten(supp), Load=flatten([loads_2, loads]), LimitDistance_m=0.005)  # -> Model, Info, Mass_kg, CenterOfGravity, LoadCaseNames
analyze = AnalyzeKaramba3D(Model=assemble.Model)  # -> CalculatedModel, MaximumDisplacement_cm, ResultingForceOfGravity_kN, ElasticEnergy_kNm
panel_13 = Panel(analyze.MaximumDisplacement_cm)
# Optimise
panel_14 = Panel(assemble.Mass_kg)
modelview = ModelViewKaramba3D(Model=analyze.CalculatedModel, ResultFactors=1, ResultCase=-1)  # -> Model, DeformedMesh, DeformedAxes, DeformedModel
beamview = BeamViewKaramba3D(Model=modelview.Model)  # -> Model, MeshesOfRenderedBeams, DeformedBeamAxes, LegendColors, LegendTags
mesh_2 = Mesh(beamview.MeshesOfRenderedBeams)
faceb_2 = FaceBoundaries(Mesh=beamview.MeshesOfRenderedBeams)

legend = Legend(Colour=beamview.LegendColors, Tags=beamview.LegendTags, LegendType=1)

# ----
# Beam View
# Model View
# Analyse
# Optimise
# Assemble the Model
# Cross-Sections
# Create Beams
# Create Supports
# Gravity Load
# Create Supports
# Extra Load
end = EndPoints(Curve=merge)  # -> Start, End
pt_4 = Point([Point(-193.0990568, -98.09126098, 0), Point(-192.8709537, -96.38331743, 0), Point(-191.8551625, -94.6004795, 0), Point(-190.2354467, -93.64155267, 0), Point(-188.080058, -93.35184833, 0), Point(-185.9728811, -93.20859869, 0)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])
# CASE 1 - GRID SHELL
crosecrselect = CrossSectionRangeSelectorKaramba3D(MaximumHeight_cm=-1, MaximumWidth_cm=-1, menu=[dropdown(9), dropdown(3), dropdown(2)])
panel_15 = Panel(crosecrselect)
cps_2 = ClosestPoints(Point=pt_4, Cloud=end.Start, Count=Slider(2, range=0..10))  # -> ClosestPoint, CPIndex, Distance
Z_2 = UnitZ(Factor="-1")
item_8 = ListItem(List=flatten(crosecrselect), Index=number_slider_7, Wrap=True)
supp_2 = SupportKaramba3D(PosInd=rdpoints.OutPoint, menu=[buttons(on, on, on, on, on, on)])
linetobeam_2 = LineToBeamKaramba3D(
    Line=dupln_2,
    CrossSection=item_8,
    New=True,
    Remove=True,
    LimitDistance_m=0.005,
    Bending=True,
    SetBucklingLength=True,
    ToPolylineMaxAngle=0.03,
    ToPolylineTolerance=0.01,
    ToPolylineMinEdgeLength=0.25)  # -> Element, Points, Info
loads_3 = LoadsKaramba3D(Vector=Vector(0, 0, -1), LCase="0", mode="Gravity")

# ----
# Section Types
# Selection
pdecon_2 = Deconstruct(Point=end.Start)  # -> XComponent, YComponent, ZComponent
smaller_2 = SmallerThan(FirstNumber=pdecon_2.ZComponent, SecondNumber=Slider(0.03, range=0..1))  # -> SmallerThan, OrEqualTo
cull_4 = CullPattern(List=end.Start, CullPattern=smaller_2.SmallerThan)

# ----
# 4. Connect the
# Brep or SubD
# here
mesh_breps_2 = MeshBrepsKaramba3D(
    Brep=subd,
    MeshResolution=Slider(1, range=0..1),
    EdgeRefinementFactor=0.67,
    PointReduction=False,
    SmoothingStepSize=0,
    SmoothingIterations=5)  # -> Mesh, Info

# ----
# CASE 2 - SPACE FRAME
# Model View
# Analyse
# Optimise
# Assemble the Model
# Create Beams
# Cross-Sections
# Section Types
# Selection
# Create Supports
# Gravity Load
# Create Supports
# Extra Load
end_2 = EndPoints(Curve=merge_3)  # -> Start, End
pt_5 = Point([Point(-186.2598401, -93.18606926, 0), Point(-190.1394748, -93.67901391, 0), Point(-192.2671834, -94.95029414, 0), Point(-193.5441323, -97.15348552, 0), Point(-193.8642955, -118.5489159, 0), Point(-193.4197415, -120.824529, 0)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])
cps_3 = ClosestPoints(Point=pt_5, Cloud=end_2.Start, Count=Slider(2, range=0..10))  # -> ClosestPoint, CPIndex, Distance
crosecrselect_2 = CrossSectionRangeSelectorKaramba3D(MaximumHeight_cm=-1, MaximumWidth_cm=-1, menu=[dropdown(9), dropdown(2), dropdown(2)])
panel_16 = Panel(crosecrselect_2)
item_9 = ListItem(List=flatten(crosecrselect_2), Index=number_slider_8, Wrap=True)
Z_3 = UnitZ(Factor="-1")
linetobeam_3 = LineToBeamKaramba3D(Line=flatten(dupln_3), CrossSection=item_9, New=True, Remove=True, LimitDistance_m=0.005, Bending=Toggle(False))  # -> Element, Points, Info
loads_4 = LoadsKaramba3D(Vector=Vector(0, 0, -1), mode="Gravity")
loads_5 = LoadsKaramba3D(Vector=Z_3, Mesh=wbweave, mode="MeshLoad -Const.", menu=[buttons(off, on, off), buttons(on, on)])

# ----
# 2. Connect the
# supporting points
# here
rdpoints_3 = RemoveDuplicatePointsKaramba3D(Point=flatten(cps_3.ClosestPoint), LimitDistance=0.005)  # -> OutPoint, Info, Indexes

# ----
# 4. Connect the
# Brep or SubD
# here
mesh_breps_3 = MeshBrepsKaramba3D(
    MeshResolution=Slider(1, range=0..1),
    EdgeRefinementFactor=0.67,
    PointReduction=False,
    SmoothingStepSize=0,
    SmoothingIterations=5)  # -> Mesh, Info

supp_3 = SupportKaramba3D(PosInd=flatten(rdpoints_3.OutPoint), menu=[buttons(on, on, on, on, on, on)])
assemble_2 = AssembleModelKaramba3D(Elem=flatten(linetobeam_3.Element), Support=supp_3, Load=flatten([loads_5, loads_4]), LimitDistance_m=0.005)  # -> Model, Info, Mass_kg, CenterOfGravity
panel_17 = Panel(assemble_2.Mass_kg)
analyze_2 = AnalyzeKaramba3D(Model=assemble_2.Model)  # -> CalculatedModel, MaximumDisplacement_cm, ResultingForceOfGravity_kN, ElasticEnergy_kNm
panel_18 = Panel(analyze_2.MaximumDisplacement_cm)
modelview_2 = ModelViewKaramba3D(Model=analyze_2.CalculatedModel, ResultFactors=1, ResultCase=-1)  # -> Model, DeformedMesh, DeformedAxes, DeformedModel
beamview_2 = BeamViewKaramba3D(Model=modelview_2.Model)  # -> Model, MeshesOfRenderedBeams, DeformedBeamAxes, LegendColors, LegendTags

legend_2 = Legend(Colour=beamview_2.LegendColors, Tags=beamview_2.LegendTags, LegendType=1)

# ----
# CASE 3 - CONCRETE SHELL
# Model View
# Shell View
# Analyse
# Assemble the Model
# Create Shell
# Optimise
# Create Supports
# Create Supports
# Gravity Load
# Extra Load
number_slider_10 = Slider(0.5, range=0..1)
pt_6 = Point([Point(-183.1709179, -92.97954419, 0), Point(-185.2833142, -92.89146104, 0), Point(-186.9693009, -93.20149177, 0), Point(-189.6615756, -93.7979262, 0), Point(-191.635461, -95.15977375, 0.001503174032), Point(-193.269769, -97.00776781, 0)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])
matselect = MaterialSelectionKaramba3D(menu=[dropdown(9), dropdown(19)])
Z_4 = UnitZ(Factor="-1")
cross_section = CrossSectionKaramba3D(
    FamilyNameOfCrossSection="DefaultCroSec",
    NameOfCrossSection=graft(""),
    Material=matselect,
    Height_cm=graft(number_slider_9),
    mode="Shell - Const")  # -> flatten(CrossSection)
loads_6 = LoadsKaramba3D(Vector=Vector(0, 0, -1), mode="Gravity")

# ----
# 1. Connect the
# Brep
mesh_breps_4 = MeshBrepsKaramba3D(
    Brep=subd,
    MeshResolution=number_slider_10,
    EdgeRefinementFactor=0.67,
    PointReduction=False,
    SmoothingStepSize=0,
    SmoothingIterations=5)  # -> Mesh, Info

mesh_3 = Mesh(mesh_breps_4.Mesh)
faceb_3 = FaceBoundaries(Mesh=mesh_3)

nv = NakedVertices(Mesh=mesh_3)  # -> ClothedIndex, NakedIndex, ClothedPts, NakedPts
cps_4 = ClosestPoints(Point=pt_6, Cloud=nv.NakedPts, Count=Slider(5, range=0..10))  # -> ClosestPoint, CPIndex, Distance
meshtoshell = MeshToShellKaramba3D(Mesh=mesh_3, LimitDistance_m=0.005)  # -> Element, Points, Info
loads_7 = LoadsKaramba3D(Vector=Z_4, Mesh=mesh_3, mode="MeshLoad -Const.", menu=[buttons(off, on, off), buttons(on, on)])

pt_7 = Point(flatten(nv.NakedPts))
pdecon_3 = Deconstruct(Point=pt_7)  # -> XComponent, YComponent, ZComponent
smaller_3 = SmallerThan(FirstNumber=pdecon_3.ZComponent, SecondNumber=Slider(0.2, range=0..1))  # -> SmallerThan, OrEqualTo
cull_5 = CullPattern(List=pt_7, CullPattern=smaller_3.SmallerThan)

# ----
# 2. Connect the
# supporting points
# here
rdpoints_4 = RemoveDuplicatePointsKaramba3D(Point=flatten(cull_5), LimitDistance=0.005)  # -> OutPoint, Info, Indexes

supp_4 = SupportKaramba3D(PosInd=flatten(rdpoints_4.OutPoint), menu=[buttons(on, on, on, on, on, on)])
assemble_3 = AssembleModelKaramba3D(
    Elem=flatten(meshtoshell.Element),
    Support=supp_4,
    Load=flatten([loads_7, loads_6]),
    CrossSection=cross_section,
    LimitDistance_m=0.005)  # -> Model, Info, Mass_kg, CenterOfGravity
analyze_3 = AnalyzeKaramba3D(Model=assemble_3.Model)  # -> CalculatedModel, MaximumDisplacement_cm, ResultingForceOfGravity_kN, ElasticEnergy_kNm
panel_19 = Panel(analyze_3.MaximumDisplacement_cm)
panel_20 = Panel(assemble_3.Mass_kg)
modelview_3 = ModelViewKaramba3D(Model=analyze_3.CalculatedModel, ResultFactors=1, ResultCase=-1)  # -> Model, DeformedMesh, DeformedAxes, DeformedModel

shellview = ShellViewKaramba3D(Model=modelview_3.Model, IndexOfLayer=0)  # -> Model, MeshesOfRenderedShells, LegendColors, LegendTags
legend_3 = Legend(Colour=shellview.LegendColors, Tags=shellview.LegendTags, LegendType=1)

loads_8 = LoadsKaramba3D(Vector=Z_2, Mesh=mesh_breps_2.Mesh, LCase="0", mode="MeshLoad -Const.", menu=[buttons(on, off, off), buttons(on, on)])
assemble_4 = AssembleModelKaramba3D(Elem=flatten(linetobeam_2.Element), Support=flatten(supp_2), Load=flatten([loads_8, loads_3]), LimitDistance_m=0.005)  # -> Model, Info, Mass_kg, CenterOfGravity, LoadCaseNames
panel_21 = Panel(assemble_4.Mass_kg)
analyze_4 = AnalyzeKaramba3D(Model=assemble_4.Model)  # -> CalculatedModel, MaximumDisplacement_cm, ResultingForceOfGravity_kN, ElasticEnergy_kNm
panel_22 = Panel(analyze_4.MaximumDisplacement_cm)

opticrosec = OptimizeCrossSectionKaramba3D(
    Model=analyze_4.CalculatedModel,
    CrossSections=crosecrselect,
    MaximumUtilization=Slider(0.9, range=0..1),
    MaximumDisplacement_cm=Slider(3.5, range=0..10),
    UltimateLimitStateIterations=5,
    DisplacementIterations=5,
    NumberOfSamplePoints=3,
    ElasticDesign=True,
    GammaM0=1,
    GammaM1=1.1,
    SwayFrame=True)  # -> ModelWithOptimizedCrossSections, Info, Mass_kg, MaximumDisplacement_cm, ElasticEnergyChange_kNm
panel_23 = Panel(opticrosec.Mass_kg)
panel_24 = Panel(opticrosec.MaximumDisplacement_cm)

modelview_4 = ModelViewKaramba3D(Model=opticrosec.ModelWithOptimizedCrossSections, ResultFactors=1, ResultCase=-1)  # -> Model, DeformedMesh, DeformedAxes, DeformedModel
beamview_3 = BeamViewKaramba3D(Model=modelview_4.Model)  # -> Model, MeshesOfRenderedBeams, DeformedBeamAxes, LegendColors, LegendTags

faceb_4 = FaceBoundaries(Mesh=beamview_3.MeshesOfRenderedBeams)
legend_4 = Legend(Colour=beamview_3.LegendColors, Tags=beamview_3.LegendTags, LegendType=1)
