# Grasshopper definition AC_Week6_KARAMBA_WITH-CORE.gh (Grasshopper 1.0.7)
# plug-ins: Karamba3D, Kangaroo2 Components, LunchBox

geo = Geometry([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])

# ----
# SubD Surface
subd = SubD(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)

preview = CustomPreview(Geometry=geo, Material=ColourSwatch(SwatchColor=RGB(0, 0, 0)))
debrep = DeconstructBrep(Brep=subd)  # -> Faces, Edges, Vertices
# LunchBox
number_slider = Slider(6, range=2..50)
gridbraced1d = BracedGrid1DStructure(Surface=debrep.Faces, UDivisions=number_slider, VDivisions=Slider(6, range=2..50))  # -> PrimaryLines, BraceLines, StructureNodes
pt = Point(flatten(gridbraced1d.StructureNodes))
pt_2 = Point([Point(-151.4729776, -123.9559935, 0), Point(-147.9569204, -123.0660918, 0), Point(-146.2400585, -120.6467195, 0), Point(-145.3927106, -119.1317326, 0), Point(-145.0078531, -116.9721484, 0), Point(-145.088143, -113.824788, 0)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])
merge = Merge(Data1=gridbraced1d.PrimaryLines, Data2=gridbraced1d.BraceLines)  # -> flatten(Result)
len = Length(Curve=merge)
cps = ClosestPoints(Point=pt_2, Cloud=pt, Count=Slider(2, range=0..10))  # -> ClosestPoint, CPIndex, Distance
panel = Panel(len)

# ----
# Create Supports
end = EndPoints(Curve=merge)  # -> Start, End
pdecon = Deconstruct(Point=end.Start)  # -> XComponent, YComponent, ZComponent
smaller = SmallerThan(FirstNumber=pdecon.ZComponent, SecondNumber=Slider(0.03, range=0..1))  # -> SmallerThan, OrEqualTo
cull = CullPattern(List=end.Start, CullPattern=smaller.SmallerThan)

# ----
# CORE SUPPORTS
# Create the points on the floor around the core,
# then use the gumball to bring them up near the structure
# Connect the support points
# on the 'Remove Duplicate Points'
# component to include the in the model
pt_3 = Point([Point(-168, -100, 9.837628383), Point(-171, -100, 8.388980657), Point(-174, -100, 6.497646317), Point(-177, -100, 4.746439501), Point(-177, -102, 6.670367264), Point(-177, -104, 8.434690987), Point(-174, -104, 10.238191), Point(-171, -104, 11.91458239), Point(-168, -104, 13.0652881), Point(-168, -102, 11.48763863)])
cps_2 = ClosestPoints(Point=pt_3, Cloud=end.Start, Count=Slider(3, range=0..10))  # -> ClosestPoint, CPIndex, Distance

# ----
# CORE - TO HELP PICKING THE POINTS ONLY
# It will not be included in the Karamba Model
brep = Brep(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)
split = SplitBrep(Brep=brep, Cutter=subd)
item = ListItem(List=split, Index="1", Wrap=True)

# ----
# 3. Select the
# corresponding
# number
number_slider_2 = Slider(73, range=0..88)

# ----
# 1. Connect the
# structure lines
# here
dupln = RemoveDuplicateLines(Lines=flatten(merge), Tolerance=0.01)

# ----
# 2. Connect the
# supporting points
# here
rdpoints = RemoveDuplicatePointsKaramba3D(Point=flatten([cps.ClosestPoint, cps_2.ClosestPoint]), LimitDistance=0.005)  # -> OutPoint, Info, Indexes

# ----
# CASE 1 - GRID SHELL
# Beam View
# Model View
# Analyse
# Optimise
# Assemble the Model
# Cross-Sections
# Create Beams
# Section Types
# Selection
# Create Supports
# Gravity Load
# Extra Load
crosecrselect = CrossSectionRangeSelectorKaramba3D(MaximumHeight_cm=-1, MaximumWidth_cm=-1, menu=[dropdown(9), dropdown(3), dropdown(2)])
panel_2 = Panel(crosecrselect)
Z = UnitZ(Factor="-1")
item_2 = ListItem(List=flatten(crosecrselect), Index=number_slider_2, Wrap=True)
supp = SupportKaramba3D(PosInd=rdpoints.OutPoint, menu=[buttons(on, on, on, on, on, on)])
loads = LoadsKaramba3D(Vector=Vector(0, 0, -1), LCase="0", mode="Gravity")
linetobeam = LineToBeamKaramba3D(
    Line=dupln,
    CrossSection=item_2,
    New=True,
    Remove=True,
    LimitDistance_m=0.005,
    Bending=True,
    SetBucklingLength=True,
    ToPolylineMaxAngle=0.03,
    ToPolylineTolerance=0.01,
    ToPolylineMinEdgeLength=0.25)  # -> Element, Points, Info

# ----
# 4. Connect the
# Brep or SubD
# here
mesh_breps = MeshBrepsKaramba3D(
    Brep=subd,
    MeshResolution=Slider(1, range=0..1),
    EdgeRefinementFactor=0.67,
    PointReduction=False,
    SmoothingStepSize=0,
    SmoothingIterations=5)  # -> Mesh, Info

loads_2 = LoadsKaramba3D(Vector=Z, Mesh=mesh_breps.Mesh, LCase="0", mode="MeshLoad -Const.", menu=[buttons(on, off, off), buttons(on, on)])
assemble = AssembleModelKaramba3D(Elem=flatten(linetobeam.Element), Support=flatten(supp), Load=flatten([loads_2, loads]), LimitDistance_m=0.005)  # -> Model, Info, Mass_kg, CenterOfGravity, LoadCaseNames
panel_3 = Panel(assemble.Mass_kg)
analyze = AnalyzeKaramba3D(Model=assemble.Model)  # -> CalculatedModel, MaximumDisplacement_cm, ResultingForceOfGravity_kN, ElasticEnergy_kNm
panel_4 = Panel(analyze.MaximumDisplacement_cm)
opticrosec = OptimizeCrossSectionKaramba3D(
    Model=analyze.CalculatedModel,
    CrossSections=crosecrselect,
    MaximumUtilization=Slider(0.9, range=0..1),
    MaximumDisplacement_cm=Slider(3.5, range=0..10),
    UltimateLimitStateIterations=5,
    DisplacementIterations=5,
    NumberOfSamplePoints=3,
    ElasticDesign=True,
    GammaM0=1,
    GammaM1=1.1,
    SwayFrame=True)  # -> ModelWithOptimizedCrossSections, Info, Mass_kg, MaximumDisplacement_cm, ElasticEnergyChange_kNm
panel_5 = Panel(opticrosec.Mass_kg)
# Optimise
panel_6 = Panel(opticrosec.MaximumDisplacement_cm)
modelview = ModelViewKaramba3D(Model=opticrosec.ModelWithOptimizedCrossSections, ResultFactors=1, ResultCase=-1)  # -> Model, DeformedMesh, DeformedAxes, DeformedModel
beamview = BeamViewKaramba3D(Model=modelview.Model)  # -> Model, MeshesOfRenderedBeams, DeformedBeamAxes, LegendColors, LegendTags
faceb = FaceBoundaries(Mesh=beamview.MeshesOfRenderedBeams)
# Model View
# Shell View
legend = Legend(Colour=beamview.LegendColors, Tags=beamview.LegendTags, LegendType=1)
